# Grasshopper definition CurveTimestamps.gh (Grasshopper 1.0.7)
# plug-ins: SelectLayerfromGeoJSON, Pufferfish, Wombat

# ---- group: Load Curves
panel = Panel("C:\Dropbox\WFP_Central American Migration\10_SURVEY\Analysis_2022\20220518_Migration_Map\data file\20220518\route_num_migrt_cost1.")
file_extension = Panel("shp")
concat = Concatenate(FragmentA=panel, FragmentB=file_extension)
readshapefile = ReadShapefile(shapefile=concat, Read=Toggle(True))  # -> Geometry, Attributes, Values

# ----
spread_of_curves = Slider(0.5, range=0.25..1.5)
number_of_curves = ValueList({"500", "1000", "2000"}, selected="2000")

# ---- group: Rebuild curves so they arent shitty
join = JoinCurves(Curves=flatten(readshapefile.Geometry), Preserve=False)
cp = ControlPoints(Curve=join)  # -> Points, Weights, Knots
lng = ListLength(List=cp.Points)
multiplication = Multiplication(A=lng, B=Slider(0.001, range=0..0.001))
reb = RebuildCurve(Curve=graft(readshapefile.Geometry), Degree=1, Count=multiplication, Tangents=False)

# ---- group: Simplify Curves
pcol = PolylineCollapse(Polyline=readshapefile.Geometry, Tolerance="0.1")  # -> Polyline, Count

# ---- group: Snap Curve endpoints together
end = EndPoints(Curve=flatten(pcol.Polyline))  # -> Start, End
join_tolerance = Panel("0.05")
weave = Weave(Pattern=[0, 1], Stream0=end.Start, Stream1=end.End, NullGaps=False)
cullpt = CullDuplicates(Points=weave, Tolerance=join_tolerance, CullMode=3)  # -> Points, Indices, Valence
graft = GraftTree(Tree=weave, IncludeEmptyLists=True, IncludeNullItems=True)
cp_2 = ClosestPoint(Point=graft(graft), Cloud=cullpt.Points)  # -> ClosestPoint, CPIndex, Distance
replace = ReplaceItems(List=graft, Item=cp_2.ClosestPoint, Indices="0", Wrap=False)  # -> simplify(flatten(List))
cp_3 = ControlPoints(Curve=pcol.Polyline)  # -> Points, Weights, Knots
lng_2 = ListLength(List=cp_3.Points)  # -> simplify(Length)
partition = PartitionList(List=replace, Size="2")
lng_3 = ListLength(List=flatten(lng_2))  # -> simplify(Length)
dup = DuplicateData(Data="0", Number=lng_3, Order=True)  # -> simplify(graft(Data))
subtraction = Subtraction(A=lng_2, B=1)
merge = Merge(Data1=dup, Data2=subtraction)  # -> simplify(Result)
replace_2 = ReplaceItems(List=cp_3.Points, Item=partition, Indices=merge, Wrap=False)  # -> simplify(List)
intcrv = Interpolate(Vertices=replace_2, Degree=1, Periodic=False, KnotStyle=1)  # -> Curve, Length, Domain

# ---- group: Network Join / Shatter at every intersection and merge back with unshattered curves
flatten = FlattenTree(Tree=intcrv.Curve, Path="{0}")  # disabled
mcx = MultipleCurves(Curves=flatten)  # -> Points, IndexA, IndexB, ParamA, ParamB; disabled
merge_2 = Merge(Data1=mcx.IndexA, Data2=mcx.IndexB)  # disabled
merge_3 = Merge(Data1=mcx.ParamA, Data2=mcx.ParamB)  # disabled
cset = CreateSet(List=merge_2)  # -> Set, Map; disabled
python = GhPythonScript(x=flatten, y=cset.Set)  # -> out, a; inputs x: list, y: list; disabled
# ---------- python: Python ----------
__author__ = "nikod"
__version__ = "2022.06.12"

import rhinoscriptsyntax as rs

list = []
for i,v in enumerate(x):
    if i not in y:
        list.append(i)
    else:
        pass

a=list
# ---------- end python ----------
sort = SortList(Keys=cset.Set)  # -> Keys, ValuesA; disabled
item = ListItem(List=flatten, Index=python.a, Wrap=True)  # disabled
item_2 = ListItem(List=flatten, Index=cset.Set, Wrap=True)  # disabled
mindex = MemberIndex(Set=merge_2, Member=cset.Set)  # -> Index, Count; disabled
sort_2 = SortList(Keys=cset.Map, ValuesA=merge_3)  # -> Keys, ValuesA; disabled
partition_2 = PartitionList(List=sort_2.ValuesA, Size=mindex.Count)  # disabled
shatter = Shatter(Curve=graft(item_2), Parameters=partition_2)  # -> simplify(flatten(Segments)); disabled
ins = InsertItems(List=shatter, Item=item, Indices=python.a, Wrap=True)  # -> simplify(List); disabled

# ---- group: Network Join / Working Properly
geo = Geometry([<curve referenced from the Rhino model> x23])  # disabled
listdexs = ListIndices(List=geo)  # disabled
item_3 = ListItem(List=listdexs, Index=0, Wrap=True)  # -> Item3, Item2, Item1, Item, Item1_2, Item2_2; disabled
merge_4 = Merge(Data1=item_3.Item3, Data2=item_3.Item2, Data3=item_3.Item1)  # disabled
merge_5 = Merge(Data1=item_3.Item, Data2=item_3.Item1_2, Data3=item_3.Item2_2)  # disabled
python_2 = GhPythonScript(x=geo, y=merge_5, z=merge_4)  # -> out, a; inputs x: list, y: list of Int32, z: list of Int32; disabled
# ---------- python_2: Python ----------
__author__ = "nikod"
__version__ = "2022.06.11"

import rhinoscriptsyntax as rs

rcCrvs = []
test = []

#start by collecting initial curves
for i in y:
    rcCrvs.append(x[i])
    test.append(x[i])

b= test
#good curves to select
filterCrvs = []


for c in rcCrvs:
    domain = rs.CurveDomain(c) #   get domain of newly joined curve 
    for i, p in enumerate(x): # test with curve pool
        domainPool = rs.CurveDomain(p)
        ccx = rs.CurveCurveIntersection(c,p) # test for intersection
        if ccx != None and ccx[0][0] != 2: #filter out only the results that occured at points and not overlap
            if int(ccx[0][5]) == int(domain[1]): #check to see if the interesection happens at the end of the curve joined curve
                join = rs.JoinCurves([p,c]) # join new segment to curve
                if i in z and len(join) == 1: #add joined curve to output list
                    filterCrvs.append(join[0])
                elif len(join) == 1: #otherwise add it back into the search list
                    rcCrvs.append(join[0])
                else:
                    print ('crv failed to join')
                

a = filterCrvs
# ---------- end python_2 ----------

# ---- group: Network Join / remap domains
panel_2 = Panel("0 to 1")  # disabled
crvdom = CurveDomain(Curve=ins, Domain=panel_2)  # -> Curve, Domain; disabled

# ---- group: Network Join / Filter duplicate curves
end_2 = EndPoints(Curve=graft(crvdom.Curve))  # -> Start, End; disabled
merge_6 = Merge(Data1=end_2.Start, Data2=end_2.End)  # disabled
ma = MassAddition(Input=merge_6)  # -> Result, PartialResults; disabled
trim = TrimTree(Tree=ma.Result, Depth=1)  # disabled
cset_2 = CreateSet(List=trim)  # -> Set, Map; disabled
mindex_2 = MemberIndex(Set=trim, Member=cset_2.Set)  # -> Index, Count; disabled
cset_3 = CreateSet(List=cset_2.Map)  # -> Set, Map; disabled
larger = LargerThan(FirstNumber=mindex_2.Count, SecondNumber=1)  # -> LargerThan, OrEqualTo; disabled
dispatch = Dispatch(List=crvdom.Curve, DispatchPattern=larger.LargerThan)  # -> ListA, ListB; disabled
geo_2 = Geometry(dispatch.ListB)  # disabled
panel_3 = Panel("19")  # disabled
cull_i = CullIndex(List=geo_2, Indices=panel_3, Wrap=True)  # disabled

# ----
start = Panel("""0
2
40
68
43""")
end_3 = Panel("""18
63
6
9
7
57""")

# ---- group: Network Join / Get list to identify start and end indices
number_slider = Slider(1, range=1..3)  # disabled
curvepoint = PointOnCurve(cull_i, parameter=0.5)  # disabled
points = PointList(Points=curvepoint, Size=number_slider)  # disabled

# ---- group: Network Join / Perform network analysis
python_3 = GhPythonScript(x=cull_i, y=start, z=end_3)  # -> out, a; inputs x: list, y: list of Int32, z: list of Int32; disabled; same code as python_2

# ---- group: Full Curves
geo_3 = Geometry(simplify(graft([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])))

# ---- group: Number of curves
lng_4 = ListLength(List=flatten(geo_3))
division = Division(A=number_of_curves, B=lng_4)
int = Integer(division)
curvepoint_2 = PointOnCurve(geo_3, parameter=0.5)
divide = DivideCurve(Curve=geo_3, Count=int, Kinks=False)  # -> Points, Tangents, Parameters

# ---- group: Move curves randomly
graft_2 = GraftTree(Tree=geo_3, IncludeEmptyLists=True, IncludeNullItems=True)  # -> simplify(Tree)
lng_5 = ListLength(List=flatten(divide.Points))
lng_6 = ListLength(List=divide.Points)
random = Random(Range="-360 to 360", Number=lng_5, Seed="5")
random_2 = Random(Range="-360 to 360", Number=lng_5, Seed=2)
partition_3 = PartitionList(List=random, Size=flatten(lng_6))
partition_4 = PartitionList(List=random_2, Size=flatten(lng_6))
vec = VectorXYZ(XComponent=partition_4, YComponent=partition_3, ZComponent=0)  # -> Vector, Length
amp = Amplitude(Vector=vec.Vector, Amplitude=spread_of_curves)  # -> simplify(Vector)
move = Move(Geometry=graft_2, Motion=amp)  # -> Geometry, Transform

# ---- group: Site curves
geo_4 = Geometry(Tree({0;1}: [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], {1;1}: [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], {2;1}: [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]))

# ---- group: Full Curves
geo_5 = Geometry(simplify(graft([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])))

# ----
bang = ExplodeTree(Data=geo_4)  # -> simplify(Branch0), simplify(Branch1), simplify(Branch2)
division_2 = Division(A=Slider(30000, range=0..100000), B="727")
split = SplitTree(Data=move.Geometry, Masks=flatten("{0}"))  # -> Positive, Negative
dup_2 = DuplicateData(Data=graft(bang.Branch0), Number="25", Order=True)  # -> simplify(Data)
item_4 = ListItem(List=split.Positive, Index=0, Wrap=True)
panel_4 = Panel(division_2)
len = Length(Curve=item_4)
item_5 = ListItem(List=len, Index=0, Wrap=True)  # -> flatten(Item)
bnd = Bounds(Numbers=item_5)
remap = RemapNumbers(Value=item_5, Source=bnd, Target="10 to 5")  # -> Mapped, Clipped
int_2 = Integer(remap.Mapped)
dup_3 = DuplicateData(Data=item_4, Number=graft(int_2), Order=True)
lng_7 = ListLength(List=flatten(item_4))

# ---- group: Create random speed and start times
cp_4 = ControlPoints(Curve=item_4)  # -> Points, Weights, Knots
number_slider_2 = Slider(2000, range=1..2000)
tstat = TreeStatistics(Tree=item_4)  # -> Paths, Length, Count
number_slider_3 = Slider(300, range=1..300)
lng_8 = ListLength(List=cp_4.Points)
lng_9 = ListLength(List=item_4)
len_2 = Length(Curve=item_4)  # -> simplify(graft(Length))
sqrt = SquareRoot(Value=len_2)
dom = ConstructDomain(DomainStart="0", DomainEnd="20000")
sqrt_2 = SquareRoot(Value=sqrt)
random_3 = Random(Range="0.66 to 1.33", Number=lng_9, Seed=2, Integers=False)  # -> simplify(graft(Random))
multiplication_2 = Multiplication(A=sqrt_2, B="10")
multiplication_3 = Multiplication(A=multiplication_2, B=random_3)
series = Series(Start="0", Step="100", Count=lng_8)

# ----
random_4 = Random(Range=dom, Number=lng_7, Seed=2, Integers=True)  # -> simplify(graft(Random))
trim_2 = TrimTree(Tree=multiplication_3, Depth=1)
trim_3 = TrimTree(Tree=multiplication_2, Depth=1)

# ---- group: Export to SHP
lng_10 = ListLength(List=item_4)
panel_5 = Panel("C:\Users\nikod\Documents\GitHub\nt-migration-globemap\Trips\trips\data\shpdesktop")
dup_4 = DuplicateData(Data="0", Number=lng_10, Order=True)  # -> flatten(Data)
file_extension_2 = Panel("prj")
graft_3 = GraftTree(Tree=dup_4, IncludeEmptyLists=True, IncludeNullItems=True)  # -> simplify(Tree)
concat_2 = Concatenate(FragmentA=panel, FragmentB=file_extension_2)
write_shp = WriteSHP(
    geometry=flatten(item_4),
    fields="null",
    values=graft_3,
    path=panel_5,
    filename="debug",
    Activate=Button(),
    projection=concat_2)  # inputs geometry: list of GeometryBase, fields: list, values: tree
# ---------- write_shp: Python ----------
"""Write shapefile.py

Writes GH Geometries into ESRI Shapefiles.
based on the work of jlawhead<at>geospatialpython.com

	Typical usage:
		Input geoemtry, projection and a boolean.

	Inputs:
		geometry: List of geometry objects to save in shapefile.
		fields: List of attribute names for all geometry objects.
		values: Tree with attribute values for all geometry objects.
		path: Path to destination file.
		filename: destination file name.
		Activate: Boolean to write shapefile.
		projection: map projection to create PRJ file (required for readShapefile)

	Outputs:
		None"""

__author__ = "palomagr"
__version__ = "2020.07.09"

#ghenv.Component.Name = "Write ShapeFile"
#ghenv.Component.NickName = "Write ShapeFile"


from ghpythonlib.componentbase import executingcomponent as component
import Grasshopper, GhPython, System, Rhino
import rhinoscriptsyntax as rs
from struct import pack, unpack, calcsize, error
import os, time, array
from Grasshopper.Kernel import GH_RuntimeMessageLevel as RML

class MyComponent(component):

    def RunScript(self, geometry, fields, values, path, filename, Activate, projection):
        if geometry == None:
            self.AddRuntimeMessage(RML.Warning, "Add geometry in branches.")
        if path == None:
            self.AddRuntimeMessage(RML.Warning, "Add a path as a string.")
        if filename == None:
            self.AddRuntimeMessage(RML.Warning, "Add a filename as a string.")
        if Activate == None:
            self.AddRuntimeMessage(RML.Warning, "Add a boolean toggle for Activate.")
            
        import sys
        # Constants for shape types
        NULL = 0
        POINT = 1
        POLYLINE = 3
        POLYGON = 5
        MULTIPOINT = 8
        POINTZ = 11
        POLYLINEZ = 13
        POLYGONZ = 15
        MULTIPOINTZ = 18
        POINTM = 21
        POLYLINEM = 23
        POLYGONM = 25
        MULTIPOINTM = 28
        MULTIPATCH = 31

        PYTHON3 = sys.version_info[0] == 3

        def b(v):
            if PYTHON3:
                if isinstance(v, str):
                    # For python 3 encode str to bytes.
                    return v.encode('utf-8')
                elif isinstance(v, bytes):
                    # Already bytes.
                    return v
                else:
                    # Error.
                    raise Exception('Unknown input type')
                    #self.AddRuntimeMessage(RML.Warning,'Unknown input type')
            else:
                # For python 2 assume str passed in and return str.
                return v

        def u(v):
            if PYTHON3:
                if isinstance(v, bytes):
                    # For python 3 decode bytes to str.
                    return v.decode('utf-8')
                elif isinstance(v, str):
                    # Already str.
                    return v
                else:
                    # Error.
                    raise Exception('Unknown input type')
            else:
                # For python 2 assume str passed in and return str.
                return v

        def is_string(v):
            if PYTHON3:
                return isinstance(v, str)
            else:
                return isinstance(v, basestring)

        class _Array(array.array):
            """Converts python tuples to lits of the appropritate type.
            Used to unpack different shapefile header parts."""
            def __repr__(self):
                return str(self.tolist())

        class _Shape:
            def __init__(self, shapeType=None):
                """Stores the geometry of the different shape types
                specified in the Shapefile spec. Shape types are
                usually point, polyline, or polygons. Every shape type
                except the "Null" type contains points at some level for
                example verticies in a polygon. If a shape type has
                multiple shapes containing points within a single
                geometry record then those shapes are called parts. Parts
                are designated by their starting index in geometry record's
                list of shapes."""
                self.shapeType = shapeType
                self.points = []

        class _ShapeRecord:
            """A shape object of any type."""
            def __init__(self, shape=None, record=None):
                self.shape = shape
                self.record = record

        class ShapefileException(Exception):
            """An exception to handle shapefile specific problems."""
            pass

        class Writer:
            """Provides write support for ESRI Shapefiles."""
            def __init__(self, shapeType=None):
                self._shapes = []
                self.fields = []
                self.records = []
                self.shapeType = shapeType
                self.shp = None
                self.shx = None
                self.dbf = None
                # Geometry record offsets and lengths for writing shx file.
                self._offsets = []
                self._lengths = []
                # Use deletion flags in dbf? Default is false (0).
                self.deletionFlag = 0

            def __getFileObj(self, f):
                """Safety handler to verify file-like objects"""
                if not f:
                    raise ShapefileException("No file-like object available.")
                elif hasattr(f, "write"):
                    return f
                else:
                    pth = os.path.split(f)[0]
                    if pth and not os.path.exists(pth):
                        os.makedirs(pth)
                    return open(f, "wb")

            def __shpFileLength(self):
                """Calculates the file length of the shp file."""
                # Start with header length
                size = 100
                # Calculate size of all shapes
                for s in self._shapes:
                    # Add in record header and shape type fields
                    size += 12
                    # nParts and nPoints do not apply to all shapes
                    #if self.shapeType not in (0,1):
                    #       nParts = len(s.parts)
                    #       nPoints = len(s.points)
                    if hasattr(s,'parts'):
                        nParts = len(s.parts)
                    if hasattr(s,'points'):
                        nPoints = len(s.points)
                    # All shape types capable of having a bounding box
                    if self.shapeType in (3,5,8,13,15,18,23,25,28,31):
                        size += 32
                    # Shape types with parts
                    if self.shapeType in (3,5,13,15,23,25,31):
                        # Parts count
                        size += 4
                        # Parts index array
                        size += nParts * 4
                    # Shape types with points
                    if self.shapeType in (3,5,8,13,15,23,25,31):
                        # Points count
                        size += 4
                        # Points array
                        size += 16 * nPoints
                    # Calc size of part types for Multipatch (31)
                    if self.shapeType == 31:
                        size += nParts * 4
                    # Calc z extremes and values
                    if self.shapeType in (13,15,18,31):
                        # z extremes
                        size += 16
                        # z array
                        size += 8 * nPoints
                    # Calc m extremes and values
                    if self.shapeType in (23,25,31):
                        # m extremes
                        size += 16
                        # m array
                        size += 8 * nPoints
                    # Calc a single point
                    if self.shapeType in (1,11,21):
                        size += 16
                    # Calc a single Z value
                    if self.shapeType == 11:
                        size += 8
                    # Calc a single M value
                    if self.shapeType in (11,21):
                        size += 8
                # Calculate size as 16-bit words
                size //= 2
                return size

            def __bbox(self, shapes, shapeTypes=[]):
                x = []
                y = []
                for s in shapes:
                    shapeType = self.shapeType
                    if shapeTypes:
                        shapeType = shapeTypes[shapes.index(s)]
                    px, py = list(zip(*s.points))[:2]
                    x.extend(px)
                    y.extend(py)
                return [min(x), min(y), max(x), max(y)]

            def __zbox(self, shapes, shapeTypes=[]):
                z = []
                for s in shapes:
                    try:
                        for p in s.points:
                            z.append(p[2])
                    except IndexError:
                        pass
                if not z: z.append(0)
                return [min(z), max(z)]

            def __mbox(self, shapes, shapeTypes=[]):
                m = [0]
                for s in shapes:
                    try:
                        for p in s.points:
                            m.append(p[3])
                    except IndexError:
                        pass
                return [min(m), max(m)]

            def bbox(self):
                """Returns the current bounding box for the shapefile which is
                the lower-left and upper-right corners. It does not contain the
                elevation or measure extremes."""
                return self.__bbox(self._shapes)

            def zbox(self):
                """Returns the current z extremes for the shapefile."""
                return self.__zbox(self._shapes)

            def mbox(self):
                """Returns the current m extremes for the shapefile."""
                return self.__mbox(self._shapes)

            def __shapefileHeader(self, fileObj, headerType='shp'):
                """Writes the specified header type to the specified file-like object.
                Several of the shapefile formats are so similar that a single generic
                method to read or write them is warranted."""
                f = self.__getFileObj(fileObj)
                f.seek(0)
                # File code, Unused bytes
                f.write(pack(">6i", 9994,0,0,0,0,0))
                # File length (Bytes / 2 = 16-bit words)
                if headerType == 'shp':
                    f.write(pack(">i", self.__shpFileLength()))
                elif headerType == 'shx':
                    f.write(pack('>i', ((100 + (len(self._shapes) * 8)) // 2)))
                # Version, Shape type
                f.write(pack("<2i", 1000, self.shapeType))
                # The shapefile's bounding box (lower left, upper right)
                if self.shapeType != 0:
                    try:
                        f.write(pack("<4d", *self.bbox()))
                    except error:
                        raise ShapefileException("Failed to write shapefile bounding box. Floats required.")
                else:
                    f.write(pack("<4d", 0,0,0,0))
                # Elevation
                z = self.zbox()
                # Measure
                m = self.mbox()
                try:
                    f.write(pack("<4d", z[0], z[1], m[0], m[1]))
                except error:
                    raise ShapefileException("Failed to write shapefile elevation and measure values. Floats required.")

            def __dbfHeader(self):
                """Writes the dbf header and field descriptors."""
                f = self.__getFileObj(self.dbf)
                f.seek(0)
                version = 3
                year, month, day = time.localtime()[:3]
                year -= 1900
                # Remove deletion flag placeholder from fields
                for field in self.fields:
                    if field[0].startswith("Deletion"):
                        self.fields.remove(field)
                numRecs = len(self.records)
                numFields = len(self.fields)
                headerLength = numFields * 32 + 33
                recordLength = sum([int(field[2]) for field in self.fields]) + 1
                header = pack('<BBBBLHH20x', version, year, month, day, numRecs,
                        headerLength, recordLength)
                f.write(header)
                # Field descriptors
                for field in self.fields:
                    name, fieldType, size, decimal = field
                    name = b(name)
                    name = name.replace(b(' '), b('_'))
                    name = name.ljust(11).replace(b(' '), b('\x00'))
                    fieldType = b(fieldType)
                    size = int(size)
                    fld = pack('<11sc4xBB14x', name, fieldType, size, decimal)
                    f.write(fld)
                # Terminator
                f.write(b('\r'))

            def __shpRecords(self):
                """Write the shp records"""
                f = self.__getFileObj(self.shp)
                f.seek(100)
                recNum = 1
                for s in self._shapes:
                    self._offsets.append(f.tell())
                    # Record number, Content length place holder
                    f.write(pack(">2i", recNum, 0))
                    recNum += 1
                    start = f.tell()
                    # Shape Type
                    f.write(pack("<i", s.shapeType))
                    # All shape types capable of having a bounding box
                    if s.shapeType in (3,5,8,13,15,18,23,25,28,31):
                        try:
                            f.write(pack("<4d", *self.__bbox([s])))
                        except error:
                            raise ShapefileException("Falied to write bounding box for record %s. Expected floats." % recNum)
                    # Shape types with parts
                    if s.shapeType in (3,5,13,15,23,25,31):
                        # Number of parts
                        f.write(pack("<i", len(s.parts)))
                    # Shape types with multiple points per record
                    if s.shapeType in (3,5,8,13,15,23,25,31):
                        # Number of points
                        f.write(pack("<i", len(s.points)))
                    # Write part indexes
                    if s.shapeType in (3,5,13,15,23,25,31):
                        for p in s.parts:
                            f.write(pack("<i", p))
                    # Part types for Multipatch (31)
                    if s.shapeType == 31:
                        for pt in s.partTypes:
                            f.write(pack("<i", pt))
                    # Write points for multiple-point records
                    if s.shapeType in (3,5,8,13,15,23,25,31):
                        try:
                            [f.write(pack("<2d", *p[:2])) for p in s.points]
                        except error:
                            raise ShapefileException("Failed to write points for record %s. Expected floats." % recNum)
                    # Write z extremes and values
                    if s.shapeType in (13,15,18,31):
                        try:
                            f.write(pack("<2d", *self.__zbox([s])))
                        except error:
                            raise ShapefileException("Failed to write elevation extremes for record %s. Expected floats." % recNum)
                        try:
                            [f.write(pack("<d", p[2])) for p in s.points]
                        except error:
                            raise ShapefileException("Failed to write elevation values for record %s. Expected floats." % recNum)
                    # Write m extremes and values
                    if s.shapeType in (23,25,31):
                        try:
                            f.write(pack("<2d", *self.__mbox([s])))
                        except error:
                            raise ShapefileException("Failed to write measure extremes for record %s. Expected floats" % recNum)
                        try:
                            [f.write(pack("<d", p[3])) for p in s.points]
                        except error:
                            raise ShapefileException("Failed to write measure values for record %s. Expected floats" % recNum)
                    # Write a single point
                    if s.shapeType in (1,11,21):
                        try:
                            f.write(pack("<2d", s.points[0][0], s.points[0][1]))
                        except error:
                            raise ShapefileException("Failed to write point for record %s. Expected floats." % recNum)
                    # Write a single Z value
                    if s.shapeType == 11:
                        try:
                            f.write(pack("<1d", s.points[0][2]))
                        except error:
                            raise ShapefileException("Failed to write elevation value for record %s. Expected floats." % recNum)
                    # Write a single M value
                    if s.shapeType in (11,21):
                        try:
                            f.write(pack("<1d", s.points[0][3]))
                        except error:
                            raise ShapefileException("Failed to write measure value for record %s. Expected floats." % recNum)
                    # Finalize record length as 16-bit words
                    finish = f.tell()
                    length = (finish - start) // 2
                    self._lengths.append(length)
                    # start - 4 bytes is the content length field
                    f.seek(start-4)
                    f.write(pack(">i", length))
                    f.seek(finish)

            def __shxRecords(self):
                """Writes the shx records."""
                f = self.__getFileObj(self.shx)
                f.seek(100)
                for i in range(len(self._shapes)):
                    f.write(pack(">i", self._offsets[i] // 2))
                    f.write(pack(">i", self._lengths[i]))

            def __dbfRecords(self):
                """Writes the dbf records."""
                f = self.__getFileObj(self.dbf)
                for record in self.records:
                    if not self.fields[0][0].startswith("Deletion"):
                        f.write(b(' ')) # deletion flag
                    for (fieldName, fieldType, size, dec), value in zip(self.fields, record):
                        fieldType = fieldType.upper()
                        size = int(size)
                        if fieldType.upper() == "N":
                            value = str(value).rjust(size)
                        elif fieldType == 'L':
                            value = str(value)[0].upper()
                        else:
                            value = str(value)[:size].ljust(size)
                        assert len(value) == size
                        value = b(value)
                        f.write(value)

            def null(self):
                """Creates a null shape."""
                self._shapes.append(_Shape(NULL))

            def point(self, x, y, z=0, m=0):
                """Creates a point shape."""
                pointShape = _Shape(self.shapeType)
                pointShape.points.append([x, y, z, m])
                self._shapes.append(pointShape)

            def line(self, parts=[], shapeType=POLYLINE):
                """Creates a line shape. This method is just a convienience method
                which wraps 'poly()'.
                """
                self.poly(parts, shapeType, [])

            def poly(self, parts=[], shapeType=POLYGON, partTypes=[]):
                """Creates a shape that has multiple collections of points (parts)
                including lines, polygons, and even multipoint shapes. If no shape type
                is specified it defaults to 'polygon'. If no part types are specified
                (which they normally won't be) then all parts default to the shape type.
                """
                polyShape = _Shape(shapeType)
                polyShape.parts = []
                polyShape.points = []
                for part in parts:
                    polyShape.parts.append(len(polyShape.points))
                    for point in part:
                        # Ensure point is list
                        if not isinstance(point, list):
                            point = list(point)
                        # Make sure point has z and m values
                        while len(point) < 4:
                            point.append(0)
                        polyShape.points.append(point)
                if polyShape.shapeType == 31:
                    if not partTypes:
                        for part in parts:
                            partTypes.append(polyShape.shapeType)
                    polyShape.partTypes = partTypes
                self._shapes.append(polyShape)

            def field(self, name, fieldType="C", size="50", decimal=0):
                """Adds a dbf field descriptor to the shapefile."""
                self.fields.append((name, fieldType, size, decimal))

            def record(self, *recordList, **recordDict):
                """Creates a dbf attribute record. You can submit either a sequence of
                field values or keyword arguments of field names and values. Before
                adding records you must add fields for the record values using the
                fields() method. If the record values exceed the number of fields the
                extra ones won't be added. In the case of using keyword arguments to specify
                field/value pairs only fields matching the already registered fields
                will be added."""
                record = []
                fieldCount = len(self.fields)
                # Compensate for deletion flag
                if self.fields[0][0].startswith("Deletion"): fieldCount -= 1
                if recordList:
                    [record.append(recordList[i]) for i in range(fieldCount)]
                elif recordDict:
                    for field in self.fields:
                        if field[0] in recordDict:
                            val = recordDict[field[0]]
                            if val:
                                record.append(val)
                            else:
                                record.append("")
                if record:
                    self.records.append(record)

            def shape(self, i):
                return self._shapes[i]

            def shapes(self):
                """Return the current list of shapes."""
                return self._shapes

            def saveShp(self, target):
                """Save an shp file."""
                if not hasattr(target, "write"):
                    target = os.path.splitext(target)[0] + '.shp'
                if not self.shapeType:
                    self.shapeType = self._shapes[0].shapeType
                self.shp = self.__getFileObj(target)
                self.__shapefileHeader(self.shp, headerType='shp')
                self.__shpRecords()

            def saveShx(self, target):
                """Save an shx file."""
                if not hasattr(target, "write"):
                    target = os.path.splitext(target)[0] + '.shx'
                if not self.shapeType:
                    self.shapeType = self._shapes[0].shapeType
                self.shx = self.__getFileObj(target)
                self.__shapefileHeader(self.shx, headerType='shx')
                self.__shxRecords()

            def saveDbf(self, target):
                """Save a dbf file."""
                if not hasattr(target, "write"):
                    target = os.path.splitext(target)[0] + '.dbf'
                self.dbf = self.__getFileObj(target)
                self.__dbfHeader()
                self.__dbfRecords()

            def save(self, target=None, shp=None, shx=None, dbf=None):
                """Save the shapefile data to three files or
                three file-like objects. SHP and DBF files can also
                be written exclusively using saveShp, saveShx, and saveDbf respectively."""
                # TODO: Create a unique filename for target if None.
                if shp:
                    self.saveShp(shp)
                if shx:
                    self.saveShx(shx)
                if dbf:
                    self.saveDbf(dbf)
                elif target:
                    self.saveShp(target)
                    self.shp.close()
                    self.saveShx(target)
                    self.shx.close()
                    self.saveDbf(target)
                    self.dbf.close()

        def Main():
            if path!=None and filename!=None:
                file = os.path.join(path, filename)
                if Activate == True:
                    if type(geometry[0]) == Rhino.Geometry.Point: # If it is a point collection
                        w = Writer(POINT)
                        for field in fields: # Write the fields in the dbf
                            w.field(field)
                        for i, pt in enumerate(geometry):
                            vals = get_fields(i, fields, values, geometry)
                            point = rs.PointCoordinates(pt) # Turn the points into Rhino pt objects
                            w.point(point.X, point.Y, point.Z) # Write the pts as shp geometry objects
                            w.record(*vals) # Write the values for each pt
                        w.save(file)

                    else:
                        if geometry[0].IsClosed == False: # If the geometry is a curve, write a line shp
               
                            w = Writer(POLYLINE)
                            for field in fields: # Write the fields in the dbf
                                w.field(field)
                            for i, crv in enumerate(geometry):
                                cp = rs.CurvePoints(crv) # get the cps of the curves
   
                                if len(cp) >1: # Make sure it's a line
                                    vals = get_fields(i, fields, values, geometry)
                                    points = [[[pt.X,pt.Y,pt.Z] for pt in cp]] # create a formated nested list from the cps to write the shp
                                    w.line(parts=points)
                                    
                                    w.record(*vals) # Write the values for each pt
                            w.save(file)

                        else: # It is a polygon
                            w = Writer(POLYGON)
                            for field in fields: # Write the fields in the dbf
                                w.field(field)
                            for i, crv in enumerate(geometry):
                                cp = rs.CurvePoints(crv) # get the cps of the curves
                                if len(cp) >1: # Make sure it's a line
                                    vals = get_fields(i, fields, values, geometry)
                                    points = [[[pt.X,pt.Y,pt.Z] for pt in cp]] # create a formated nested list from the cps to write the shp
                                    w.poly(parts=points) # Write the polylines as shp geometry objects
                                    w.record(*vals) # Write the values for each pt
                            w.save(file)
                if projection:
                    prj(file, projection)

        def get_fields(i, fields, values, geometry):
            vals = [] # Create a list to store values for each geom
            for h in range(len(fields)):
                vals.append(values[values.Path(i),h]) # I iterate through the data tree and build individual lists
            return vals

        def prj(file, epsg):
            # create the PRJ file
            prj = open("%s.prj" % file, "w")
            prj.write(epsg)
            prj.close()

#        if __name__ == "__main__":
#            Main()

        Main()

        # return outputs if you have them; here I try it for you:
        return
# ---------- end write_shp ----------

# ----
sort_3 = SortList(Keys=flatten(trim_2))  # -> Keys, ValuesA
sort_4 = SortList(Keys=flatten(trim_3))  # -> Keys, ValuesA
panel_6 = Panel("C:\Users\nikod\OneDrive\Documents\GitHub\nt-migration-globemap\Trips\trips\data\shp")
flatten_2 = FlattenTree(Tree=series, Path="{0}")

# ---- group: Timestamps
python_4 = GhPythonScript(x=series)  # -> out, simplify(time); inputs x: list
# ---------- python_4: Python ----------
__author__ = "nikod"
__version__ = "2022.06.10"

import rhinoscriptsyntax as rs

list = '"timestamps": ['

print len(x)

for i,v in enumerate(x):
    print(i)
    if i == len(x)-1:
        list += str(int(v))
    else:
        list += str(int(v)) + ','

list += ']'

time = list
# ---------- end python_4 ----------

# ----
item_6 = ListItem(List=flatten(sort_3.Keys), Index=0, Wrap=True)  # -> Item1, Item
sort_5 = SortList(Keys=flatten_2)  # -> Keys, ValuesA
item_7 = ListItem(List=flatten(sort_4.Keys), Index=0, Wrap=True)  # -> Item1, Item
item_8 = ListItem(List=sort_5.Keys, Index="-1", Wrap=True)
panel_7 = Panel(item_8)
panel_8 = Panel("C:\Users\nikod\Documents\GitHub\nt-migration-globemap\Trips\trips\data\")
name = Panel("debug")
concat_3 = Concatenate(FragmentB=name, FragmentD=".json")
concat_4 = Concatenate(FragmentA=panel_8, FragmentE="RAWJSON\", FragmentB=name, FragmentC="-RAW", FragmentD=".json")
file = ReadFile(File=concat_4, PerLineParse=True)
split_2 = TextSplit(Text=file, Separators="{}")
python_5 = GhPythonScript(x=split_2)  # -> out, a
# ---------- python_5: Python ----------
__author__ = "nikod"
__version__ = "2022.06.10"

import rhinoscriptsyntax as rs

if 'path' in x:
    a = x
else:
    None
# ---------- end python_5 ----------
clean = CleanTree(RemoveNulls=True, RemoveInvalid=True, RemoveEmpty=True, Tree=python_5.a)
panel_9 = Panel("""["path":[[-66.4741,10.2246],[-67.01,9.9816],[-67.666,10.1014],[-68.4513,9.9863],[-69.4332,9.8439],[-70.0985,9.8265],[-70.7413,9.9755],[-71.2324,10.5259],[-71.6722,11.0426],[-72.3263,10.7606],[-72.7269,10.3734],[-73.0819,9.973],[-73.5304,9.7018],[-74.0518,9.2326],[-74.7397,9.0684],[-75.1422,8.6579],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
]""")
split_3 = TextSplit(Text=clean, Separators="\"paths\":")
python_6 = GhPythonScript(x=split_3)  # -> out, a
# ---------- python_6: Python ----------
__author__ = "nikod"
__version__ = "2022.06.10"

import rhinoscriptsyntax as rs

if x != None:
    a = x[2:-2]
# ---------- end python_6 ----------
item_9 = ListItem(List=python_6.a, Index="-1", Wrap=True)  # -> simplify(Item)
coord_resolution = Panel("4")
item_10 = ListItem(List=flatten(item_9), Index=0, Wrap=True)
python_7 = GhPythonScript(x=item_9, res=coord_resolution)  # -> out, simplify(a); inputs res: Int32
# ---------- python_7: Python ----------
__author__ = "nikod"
__version__ = "2022.06.13"

import rhinoscriptsyntax as rs

new = x.translate({ord(i): None for i in '[]'})

split = new.split(',')

long = split[::2]
lat = split[1::2]

roundNum = ''
for i,v in enumerate(long):
    roundLong =  str(round(float(long[i]),res)) 
    roundLat = str(round(float(lat[i]),res)) 
    roundNum += '[' + roundLong + ',' + roundLat + '],'

FinalOut = roundNum[:-1]
a = FinalOut
# ---------- end python_7 ----------
python_8 = GhPythonScript(x=panel_9)  # -> out, a
# ---------- python_8: Python ----------
__author__ = "nikod"
__version__ = "2022.06.13"

import rhinoscriptsyntax as rs

new = x.translate({ord(i): None for i in '"": ][{} vendor path timestamp'})
long = new[::2]
lat = new[1::2]

coords = long + ',' + lat

list = new.split(',')

a = list
# ---------- end python_8 ----------
panel_10 = Panel(python_7.a)
num = Number(python_8.a)
concat_5 = Concatenate(FragmentA=graft("\"path\":"), FragmentC="[", FragmentB=python_7.a, FragmentD="]")
partition_5 = PartitionList(List=num, Size="194")
panel_11 = Panel("""False
True""")
bang_2 = ExplodeTree(Data=partition_5)  # -> Branch0, Branch1
lng_11 = ListLength(List=bang_2.Branch0)
match = MatchTree(Tree=python_4.time, Guide=concat_5)
division_3 = Division(A=lng_11, B=2)
concat_6 = Concatenate(FragmentC="{\"vendor\": 0,", FragmentA=concat_5, FragmentE=",", FragmentB=match, FragmentD="},")  # -> flatten(Result)
shift = ShiftList(List=bang_2.Branch0, Shift=division_3, Wrap=False)
item_11 = ListItem(List=concat_6, Index="-1", Wrap=True)
panel_12 = Panel(shift)
panel_13 = Panel(bang_2.Branch1)
cull_i_2 = CullIndex(List=concat_6, Indices="-1", Wrap=True)  # -> simplify(List)
python_9 = GhPythonScript(x=item_11)  # -> out, a
# ---------- python_9: Python ----------
__author__ = "nikod"
__version__ = "2022.06.12"

import rhinoscriptsyntax as rs

a = x[:len(x)-1]
# ---------- end python_9 ----------
suirify = Suirify(cull_i_2)
merge_7 = Merge(Data1=suirify, Data2=python_9.a)
merge_8 = Merge(Data1="[", Data2=merge_7, Data3="]")
concat_7 = Concatenate(FragmentA=panel_8, FragmentB=concat_3)
writetxt = WriteToTextFile(Run=Button(), TextToWrite=merge_8, FilePath=concat_7, Append=False, NewOnly=False)
